# Grasshopper definition NODEMaple Grasshopper.gh (Grasshopper 1.0.9)

nodemaple_materials = Python3Script()  # -> materials, debug
#   port debug: Materials defined in NODEMaple
# ---------- nodemaple_materials: Python ----------
"""
NODEMaple Materials — Level 1
Queries the list of available materials from the NODE Maple library.

Requires:
  - Maple installed locally (default: Maple 2026)
  - NODE Library packages installed via PackageTools

Output:
  materials : list of material names, e.g. ["steel", "timber", "concrete"]
  debug     : raw Maple output for troubleshooting
"""
import os
import subprocess

# ---------------------------------------------------------------------------
# Configuration
# ---------------------------------------------------------------------------
# Maple version, overridable via GH input or the MAPLE environment variable.
# The environment variable takes precedence since it points to a concrete
# installation (e.g. "C:\Program Files\Maple 2026").
if os.environ.get("MAPLE"):
    MAPLE_ROOT = os.environ["MAPLE"]
else:
    MAPLE_ROOT = os.path.join(r"C:\Program Files", f"Maple {maple_version}")

MAPLE_EXE = os.path.join(MAPLE_ROOT, "bin.X86_64_WINDOWS", "cmaple.exe")


def run_maple_script(script, timeout=20):
    """Run a Maple script in a fresh cmaple process and return its output.

    Starts cmaple in quiet mode (-q), feeds the script via stdin and
    collects everything written to stdout/stderr. Failures surface in
    the returned text rather than crashing Rhino.
    """
    env = dict(os.environ)
    env["MAPLE"] = MAPLE_ROOT
    # Ensure Maple's binaries are found from the subprocess on any host.
    env["PATH"] = os.path.join(MAPLE_ROOT, "bin.X86_64_WINDOWS") + \
        os.pathsep + env.get("PATH", "")

    proc = subprocess.Popen(
        [MAPLE_EXE, "-q"],
        stdin=subprocess.PIPE,
        stdout=subprocess.PIPE,
        stderr=subprocess.STDOUT,
        text=True,
        cwd=os.path.join(MAPLE_ROOT, "bin.X86_64_WINDOWS"),
        env=env,
        creationflags=subprocess.CREATE_NO_WINDOW)

    out, _ = proc.communicate(input=script, timeout=timeout)
    return out


def get_material_list():
    """Query NODEFunctions:-Materials() and return the parseable script.

    NODE modules are auto-loaded from the user's Maple toolbox
    (installed via PackageTools), so no with() call is required.
    """
    script = (
        "kernelopts(printbytes=false):\n"
        "interface(prettyprint=0):\n"
        "matlist := NODEFunctions:-Materials():\n"
        "for m in matlist do\n"
        '    printf("MAT|%s\\n", m)\n'
        "end do:\n"
        "quit:\n"
    )
    return run_maple_script(script)


# ---------------------------------------------------------------------------
# Main execution
# ---------------------------------------------------------------------------
raw = get_material_list()

materials = []
for line in raw.splitlines():
    s = line.strip()
    if s.startswith("MAT|"):
        name = s.split("|", 1)[1].strip().strip('"')
        if name:
            materials.append(name)

debug = raw  # full Maple output for troubleshooting
# ---------- end nodemaple_materials ----------
nodemaple_material_properties = Python3Script()  # -> out, categories, output_members, output_metadata, debug, probe, probe_sub
# ---------- nodemaple_material_properties: Python ----------
"""
NODEMaple Material Data — Levels 2 & 3 (tree output)
Queries grade lists ("allmembers") and property definitions ("metadata")
for all material categories in a single Maple process, and returns them
as Grasshopper data trees whose branches correspond to categories.

The branch order matches the order reported by NODEFunctions:-Materials(),
so a branch index is valid simultaneously in both trees.

Input:
  maple_version : Maple year, e.g. "2026" (ignored if MAPLE env var is set)

Output:
  members_tree  : tree, branch per category -> list of grade names
  metadata_tree : tree, branch per category -> list of property names
  categories    : ordered list of category names (branch keys, human-readable)
  debug         : raw Maple output; also shows SKIP|<category> lines
"""
import os
import subprocess
import Grasshopper
probe = [n for n in dir(Grasshopper) if not n.startswith("_")]
# also probe for a tree type:
probe_sub = []
try:
    probe_sub = [n for n in dir(Grasshopper.DataTree) if not n.startswith("_")]
except Exception as e:
    probe_sub = [f"DataTree probe failed: {e}"]
    
# ---------------------------------------------------------------------------
# Configuration
# ---------------------------------------------------------------------------
if os.environ.get("MAPLE"):
    MAPLE_ROOT = os.environ["MAPLE"]
else:
    MAPLE_ROOT = os.path.join(r"C:\Program Files", f"Maple {maple_version}")

MAPLE_PATH = os.path.join(MAPLE_ROOT, "bin.X86_64_WINDOWS", "cmaple.exe")


def run_maple_script(script, timeout=30):
    """Run a Maple script in a fresh cmaple process and return its output."""
    env = dict(os.environ)
    env["MAPLE"] = MAPLE_ROOT
    env["PATH"] = os.path.join(MAPLE_ROOT, "bin.X86_64_WINDOWS") + \
        os.pathsep + env.get("PATH", "")

    proc = subprocess.Popen(
        [MAPLE_PATH, "-q"],
        stdin=subprocess.PIPE, stdout=subprocess.PIPE,
        stderr=subprocess.STDOUT, text=True,
        cwd=os.path.join(MAPLE_ROOT, "bin.X86_64_WINDOWS"),
        env=env,
        creationflags=subprocess.CREATE_NO_WINDOW)

    out, _ = proc.communicate(input=script, timeout=timeout)
    return out


def query_material_data():
    """Fetch categories, grades and metadata in one Maple process.

    Emits: CAT|<category>          once per category, in order
           LIST|mem|<category>|<grade>
           LIST|meta|<category>|<property>
           SKIP|<category>         for unmapped categories

    NOTE: every Maple statement is terminated with ":" or ";".
    Omitting a terminator lets the parser swallow the following line
    (e.g. an inline if-expression), producing misleading syntax errors.
    """
    script_lines = [
        "kernelopts(printbytes=false):",
        "interface(prettyprint=0):",
        '# Category -> module mapping. Extend when new NODE material',
        '# packages are installed.',
        'nodetab := table(["steel"    = NODESteelMaterial,',
        '                  "timber"   = NODETimberMaterial,',
        '                  "concrete" = NODEConcreteMaterial]):',
        '# Categories are discovered at runtime, not hard-coded.',
        "cats := NODEFunctions:-Materials():",
        "known := [indices(nodetab, 'nolist')]:",
        "for c in cats do",
        '  printf("CAT|%s\\n", c):',
        "  if member(c, known) then",
        "    M := nodetab[c]:",
        '    for e in M:-Property("allmembers") do',
        '      printf("LIST|mem|%s|%s\\n", c, e):',
        "    end do:",
        '    for e in M:-Property("metadata") do',
        '      printf("LIST|meta|%s|%s\\n", c, e):',
        "    end do:",
        "  else",
        '    printf("SKIP|%s\\n", c):',
        "  end if:",
        "end do:",
        "quit:",
    ]
    return run_maple_script("\n".join(script_lines) + "\n")


# ---------------------------------------------------------------------------
# Main execution
# ---------------------------------------------------------------------------
raw = query_material_data()

categories = []                 # ordered category names (= branch keys)
members_by_cat = {}             # {"timber": [grades...]}
metadata_by_cat = {}            # {"timber": [properties...]}

for line in raw.splitlines():
    s = line.strip()
    if s.startswith("CAT|"):
        cat = s.split("|", 1)[1].strip()
        if cat:
            categories.append(cat)
            members_by_cat.setdefault(cat, [])
            metadata_by_cat.setdefault(cat, [])
    elif s.startswith("LIST|"):
        # LIST|<kind>|<category>|<entry>; entries contain "/" and ","
        parts = s.split("|", 3)
        if len(parts) == 4:
            _, kind, cat, entry = parts
            entry = entry.strip().strip('"')
            if not entry:
                continue
            if kind == "mem":
                members_by_cat.setdefault(cat, []).append(entry)
            elif kind == "meta":
                metadata_by_cat.setdefault(cat, []).append(entry)

# Instead of DataTree, return simple structures
output_members = {cat: members_by_cat.get(cat, []) for cat in categories}
output_metadata = {cat: metadata_by_cat.get(cat, []) for cat in categories}

debug = raw
# ---------- end nodemaple_material_properties ----------
panel = Panel(nodemaple_materials.materials)
panel_2 = Panel(nodemaple_materials.debug)
nodemaple_material_property = Python3Script(list_key="allmembers")  # -> results, steel, timber, concrete, debug
#   port steel: Specific material qualities defined for chosen material
# ---------- nodemaple_material_property: Python ----------
"""
NODEMaple Material Lists — Levels 2 & 3 (generic)
Enumerates a named property list (e.g. "allmembers", "metadata") for all
material categories in a single Maple process.

Inputs:
  maple_version : Maple year, e.g. "2026" (ignored if MAPLE env var is set)
  list_key      : which list to query — "allmembers" (grade names) or
                  "metadata" (defined property names)

Outputs:
  results     : dict, e.g. {"timber": ["f_m,k", ...], ...}
  steel       : list of entries for steel
  timber      : list of entries for timber
  concrete    : list of entries for concrete
  debug       : raw Maple output; also shows SKIP|<category> lines
"""
import os
import subprocess

# ---------------------------------------------------------------------------
# Configuration
# ---------------------------------------------------------------------------
if os.environ.get("MAPLE"):
    MAPLE_ROOT = os.environ["MAPLE"]
else:
    MAPLE_ROOT = os.path.join(r"C:\Program Files", f"Maple {maple_version}")

MAPLE_EXE = os.path.join(MAPLE_ROOT, "bin.X86_64_WINDOWS", "cmaple.exe")

def run_maple_script(script, timeout=30):
    """Run a Maple script in a fresh cmaple process and return its output."""
    env = dict(os.environ)
    env["MAPLE"] = MAPLE_ROOT
    env["PATH"] = os.path.join(MAPLE_ROOT, "bin.X86_64_WINDOWS") + \
        os.pathsep + env.get("PATH", "")

    proc = subprocess.Popen(
        [MAPLE_EXE, "-q"],
        stdin=subprocess.PIPE, stdout=subprocess.PIPE,
        stderr=subprocess.STDOUT, text=True,
        cwd=os.path.join(MAPLE_ROOT, "bin.X86_64_WINDOWS"),
        env=env,
        creationflags=subprocess.CREATE_NO_WINDOW)

    out, _ = proc.communicate(input=script, timeout=timeout)
    return out

def get_property_lists(list_key):
    """Query M:-Property(list_key) for all NODE categories in one process.

    Emits one tagged line per entry:  LIST|<category>|<entry>
    Categories without a module mapping are reported as:  SKIP|<category>
    """
    script_lines = [
        "kernelopts(printbytes=false):",
        "interface(prettyprint=0):",
        "# Category -> module mapping. Extend when new NODE material",
        "# packages are installed.",
        'nodetab := table(["steel"    = NODESteelMaterial,',
        '                  "timber"   = NODETimberMaterial,',
        '                  "concrete" = NODEConcreteMaterial]):',
        "# Categories are discovered at runtime, not hard-coded.",
        "cats := NODEFunctions:-Materials():",
        "known := [indices(nodetab, 'nolist')]:",
        "for c in cats do",
        "  if member(c, known) then",
        "    M := nodetab[c]:",
        f"    lst := M:-Property(\"{list_key}\"):",
        "    for e in lst do",
        '      printf("LIST|%s|%s\\n", c, e)',
        "    end do:",
        "  else",
        '    printf("SKIP|%s\\n", c)',
        "  end if:",
        "end do:",
        "quit:",
    ]
    return run_maple_script("\n".join(script_lines) + "\n")

# ---------------------------------------------------------------------------
# Main execution
# ---------------------------------------------------------------------------
raw = get_property_lists(str(list_key).strip())

results = {}     # {"steel": [...], "timber": [...], "concrete": [...]}
for line in raw.splitlines():
    s = line.strip()
    if s.startswith("LIST|"):
        # Split into 3 parts max: prefix, category, entry.
        # Entries contain commas and underscores ("f_c,0,k"), so the
        # entry itself must never be split further.
        parts = s.split("|", 2)
        if len(parts) == 3:
            _, cat, entry = parts
            entry = entry.strip().strip('"')
            if entry:
                results.setdefault(cat, []).append(entry)

# Convenience outputs for direct wiring (avoids dict lookups on canvas).
steel = results.get("steel", [])
timber = results.get("timber", [])
concrete = results.get("concrete", [])

debug = raw
# ---------- end nodemaple_material_property ----------
nodemaple_material_property_2 = Python3Script(list_key="metadata")  # -> results, steel, timber, concrete, debug; same code as nodemaple_material_property
python_3_script = Python3Script()  # -> categories, members_tree, metadata_tree, debug
# ---------- python_3_script: Python ----------
"""
NODEMaple Material Data — Levels 2 & 3 (tree output)
Queries grade lists ("allmembers") and property definitions ("metadata")
for all material categories in a single Maple process, and returns them
as Grasshopper data trees whose branches correspond to categories.

The branch order matches the order reported by NODEFunctions:-Materials(),
so a branch index is valid simultaneously in both trees.

Input:
  maple_version : Maple year, e.g. "2026" (ignored if MAPLE env var is set)

Output:
  members_tree  : tree, branch per category -> list of grade names
  metadata_tree : tree, branch per category -> list of property names
  categories    : ordered list of category names (branch keys, human-readable)
  debug         : raw Maple output; also shows SKIP|<category> lines
"""
import os
import subprocess

# ---------------------------------------------------------------------------
# Configuration
# ---------------------------------------------------------------------------
if os.environ.get("MAPLE"):
    MAPLE_ROOT = os.environ["MAPLE"]
else:
    MAPLE_ROOT = os.path.join(r"C:\Program Files", f"Maple {maple_version}")

MAPLE_PATH = os.path.join(MAPLE_ROOT, "bin.X86_64_WINDOWS", "cmaple.exe")


def run_maple_script(script, timeout=30):
    """Run a Maple script in a fresh cmaple process and return its output."""
    env = dict(os.environ)
    env["MAPLE"] = MAPLE_ROOT
    env["PATH"] = os.path.join(MAPLE_ROOT, "bin.X86_64_WINDOWS") + \
        os.pathsep + env.get("PATH", "")

    proc = subprocess.Popen(
        [MAPLE_PATH, "-q"],
        stdin=subprocess.PIPE, stdout=subprocess.PIPE,
        stderr=subprocess.STDOUT, text=True,
        cwd=os.path.join(MAPLE_ROOT, "bin.X86_64_WINDOWS"),
        env=env,
        creationflags=subprocess.CREATE_NO_WINDOW)

    out, _ = proc.communicate(input=script, timeout=timeout)
    return out


def query_material_data():
    """Fetch categories, grades and metadata in one Maple process.

    Emits: CAT|<category>          once per category, in order
           LIST|mem|<category>|<grade>
           LIST|meta|<category>|<property>
           SKIP|<category>         for unmapped categories

    NOTE: every Maple statement is terminated with ":" or ";".
    Omitting a terminator lets the parser swallow the following line
    (e.g. an inline if-expression), producing misleading syntax errors.
    """
    script_lines = [
        "kernelopts(printbytes=false):",
        "interface(prettyprint=0):",
        '# Category -> module mapping. Extend when new NODE material',
        '# packages are installed.',
        'nodetab := table(["steel"    = NODESteelMaterial,',
        '                  "timber"   = NODETimberMaterial,',
        '                  "concrete" = NODEConcreteMaterial]):',
        '# Categories are discovered at runtime, not hard-coded.',
        "cats := NODEFunctions:-Materials():",
        "known := [indices(nodetab, 'nolist')]:",
        "for c in cats do",
        '  printf("CAT|%s\\n", c):',
        "  if member(c, known) then",
        "    M := nodetab[c]:",
        '    for e in M:-Property("allmembers") do',
        '      printf("LIST|mem|%s|%s\\n", c, e):',
        "    end do:",
        '    for e in M:-Property("metadata") do',
        '      printf("LIST|meta|%s|%s\\n", c, e):',
        "    end do:",
        "  else",
        '    printf("SKIP|%s\\n", c):',
        "  end if:",
        "end do:",
        "quit:",
    ]
    return run_maple_script("\n".join(script_lines) + "\n")


# ---------------------------------------------------------------------------
# Main execution
# ---------------------------------------------------------------------------
raw = query_material_data()

categories = []                 # ordered category names (= branch keys)
members_by_cat = {}             # {"timber": [grades...]}
metadata_by_cat = {}            # {"timber": [properties...]}

for line in raw.splitlines():
    s = line.strip()
    if s.startswith("CAT|"):
        cat = s.split("|", 1)[1].strip()
        if cat:
            categories.append(cat)
            members_by_cat.setdefault(cat, [])
            metadata_by_cat.setdefault(cat, [])
    elif s.startswith("LIST|"):
        # LIST|<kind>|<category>|<entry>; entries contain "/" and ","
        parts = s.split("|", 3)
        if len(parts) == 4:
            _, kind, cat, entry = parts
            entry = entry.strip().strip('"')
            if not entry:
                continue
            if kind == "mem":
                members_by_cat.setdefault(cat, []).append(entry)
            elif kind == "meta":
                metadata_by_cat.setdefault(cat, []).append(entry)

# ---------------------------------------------------------------------------
# Build the trees — GH1 recipe
# ---------------------------------------------------------------------------
import Grasshopper                      # required: no auto-injection in GH1
from Grasshopper.Kernel.Data import GH_Path

members_tree = Grasshopper.DataTree[object]()
metadata_tree = Grasshopper.DataTree[object]()

for i, cat in enumerate(categories):
    # GH_Path(i) creates a one-level branch {i}
    members_tree.AddRange(members_by_cat.get(cat, []), GH_Path(i))
    metadata_tree.AddRange(metadata_by_cat.get(cat, []), GH_Path(i))

debug = raw
# ---------- end python_3_script ----------
list_item = ListItem(List=nodemaple_materials.materials, Index=Slider(1, range=0..2), Wrap=True)
panel_3 = Panel(nodemaple_material_properties.out)
panel_4 = Panel(nodemaple_material_properties.categories)
panel_5 = Panel(nodemaple_material_properties.probe_sub)
panel_6 = Panel(nodemaple_material_properties.output_metadata)
panel_7 = Panel(nodemaple_material_properties.probe)
panel_8 = Panel(nodemaple_material_property.results)
panel_9 = Panel(nodemaple_material_property_2.timber)
panel_10 = Panel(nodemaple_material_property.steel)
panel_11 = Panel(nodemaple_material_property.timber)
nodemaple_material_types_2a = Python3Script(material=list_item)  # -> members, debug
#   port members: Specific material qualities defined for chosen material
# ---------- nodemaple_material_types_2a: Python ----------
"""
NODEMaple Material Members — Level 2
Queries the list of specific material grades for a given material category.

Input:
  material : category name from Level 1, e.g. "steel" | "timber" | "concrete"

Output:
  members : list of grade names, e.g. ["C14", "C16", ..., "GL 32h"]
  debug   : raw Maple output for troubleshooting
"""
import os
import subprocess

# ---------------------------------------------------------------------------
# Configuration (same backbone as Level 1)
# ---------------------------------------------------------------------------
if os.environ.get("MAPLE"):
    MAPLE_ROOT = os.environ["MAPLE"]
else:
    MAPLE_ROOT = os.path.join(r"C:\Program Files", f"Maple {maple_version}")

MAPLE_EXE = os.path.join(MAPLE_ROOT, "bin.X86_64_WINDOWS", "cmaple.exe")

def run_maple_script(script, timeout=20):
    """Run a Maple script in a fresh cmaple process and return its output."""
    env = dict(os.environ)
    env["MAPLE"] = MAPLE_ROOT
    env["PATH"] = os.path.join(MAPLE_ROOT, "bin.X86_64_WINDOWS") + \
        os.pathsep + env.get("PATH", "")

    proc = subprocess.Popen(
        [MAPLE_EXE, "-q"],
        stdin=subprocess.PIPE, stdout=subprocess.PIPE,
        stderr=subprocess.STDOUT, text=True,
        cwd=os.path.join(MAPLE_ROOT, "bin.X86_64_WINDOWS"),
        env=env,
        creationflags=subprocess.CREATE_NO_WINDOW)

    out, _ = proc.communicate(input=script, timeout=timeout)
    return out

def category_to_module(category):
    """Map a Level 1 category to the corresponding Maple module name.

    "timber" -> "NODETimberMaterial", "steel" -> "NODESteelMaterial", ...
    """
    return "NODE" + category.capitalize() + "Material"

def get_member_list(module_name):
    """Query <module>:-Property("allmembers") and emit parseable output."""
    script = (
        "kernelopts(printbytes=false):\n"
        "interface(prettyprint=0):\n"
        f"M := parse(\"{module_name}\"):\n"
        "mem := M:-Property(\"allmembers\"):\n"
        "for m in mem do\n"
        '    printf("MEM|%s\\n", m)\n'
        "end do:\n"
        "quit:\n"
    )
    return run_maple_script(script)

# ---------------------------------------------------------------------------
# Main execution
# ---------------------------------------------------------------------------
module_name = category_to_module(str(material).strip().lower())

if module_name not in ("NODESteelMaterial", "NODEConcreteMaterial",
                       "NODETimberMaterial"):
    members = []
    debug = f"Unknown material category: {material!r} — " \
            "expected 'steel', 'timber' or 'concrete'."
else:
    raw = get_member_list(module_name)

    members = []
    for line in raw.splitlines():
        s = line.strip()
        if s.startswith("MEM|"):
            # Grade names contain spaces and slashes ("S 275 N/NL"),
            # so split only once and keep the rest intact.
            name = s.split("|", 1)[1].strip().strip('"')
            if name:
                members.append(name)

    debug = raw
# ---------- end nodemaple_material_types_2a ----------
panel_12 = Panel(nodemaple_material_property.concrete)
panel_13 = Panel(list_item)
panel_14 = Panel(nodemaple_material_properties.output_members)
panel_15 = Panel(python_3_script.debug)
panel_16 = Panel(python_3_script.categories)
panel_17 = Panel(nodemaple_material_properties.debug)
panel_18 = Panel(nodemaple_material_types_2a.members)
panel_19 = Panel(python_3_script.members_tree)
list_item_2 = ListItem(List=panel_9, Index=Slider(0, range=0..16), Wrap=True)
panel_20 = Panel(python_3_script.metadata_tree)
list_item_3 = ListItem(List=panel_11, Index=Slider(5, range=0..40), Wrap=True)
list_item_4 = ListItem(List=panel_8, Index=Slider(1, range=0..2), Wrap=True)
panel_21 = Panel(list_item_4)
panel_22 = Panel(list_item_3)
panel_23 = Panel(list_item_2)
material_property = Python3Script(category=panel_21, grade=panel_22, prop=panel_23)  # -> value, unit, debug
# ---------- material_property: Python ----------
"""
NODEMaple Single Property — Level 4
Fetches one property value (with units) for a single material grade
from the NODE Maple library.

Input:
  category     : material category, e.g. "timber", "steel", "concrete"
  grade        : specific grade name, e.g. "C24", "S 235", "B30"
  prop         : property name from metadata list, e.g. "f_m,k"
  maple_version: Maple year, e.g. "2026" (ignored if MAPLE env var is set)

Output:
  value : numeric property value as float, e.g. 24.0
  unit  : unit string, e.g. "Units:-Unit(N/mm^2)"
  debug : raw Maple output for troubleshooting
"""
import os
import subprocess

# ---------------------------------------------------------------------------
# Configuration
# ---------------------------------------------------------------------------
if os.environ.get("MAPLE"):
    MAPLE_ROOT = os.environ["MAPLE"]
else:
    MAPLE_ROOT = os.path.join(r"C:\Program Files", f"Maple {maple_version}")

MAPLE_PATH = os.path.join(MAPLE_ROOT, "bin.X86_64_WINDOWS", "cmaple.exe")

def run_maple_script(script, timeout=20):
    """Run a Maple script in a fresh cmaple process and return its output."""
    env = dict(os.environ)
    env["MAPLE"] = MAPLE_ROOT
    env["PATH"] = os.path.join(MAPLE_ROOT, "bin.X86_64_WINDOWS") + \
        os.pathsep + env.get("PATH", "")

    proc = subprocess.Popen(
        [MAPLE_PATH, "-q"],
        stdin=subprocess.PIPE, stdout=subprocess.PIPE,
        stderr=subprocess.STDOUT, text=True,
        cwd=os.path.join(MAPLE_ROOT, "bin.X86_64_WINDOWS"),
        env=env,
        creationflags=subprocess.CREATE_NO_WINDOW)

    out, _ = proc.communicate(input=script, timeout=timeout)
    return out

def category_to_module(category):
    """Map a material category to its Maple module name.

    "timber" -> "NODETimberMaterial", "steel" -> "NODESteelMaterial", ...
    """
    return "NODE" + category.capitalize() + "Material"

# ---------------------------------------------------------------------------
# Main execution
# ---------------------------------------------------------------------------
category = str(category).strip().lower()
module_name = category_to_module(category)
grade = str(grade).strip()
prop = str(prop).strip()

script = (
    "kernelopts(printbytes=false):\n"
    "interface(prettyprint=0):\n"
    f'p := {module_name}:-Property("{grade}", "{prop}"):\n'
    "q := Units:-Split(p):\n"
    'printf("VALUE=%a\\n", evalf(q[1])):\n'
    'printf("UNIT=%a\\n", q[2]):\n'
    "quit:\n"
)

raw = run_maple_script(script)

value = None
unit = None

for line in raw.splitlines():
    s = line.strip()
    if s.startswith("VALUE="):
        try:
            value = float(s.split("=", 1)[1])
        except ValueError:
            pass
    elif s.startswith("UNIT="):
        unit = s.split("=", 1)[1]

debug = raw
# ---------- end material_property ----------
panel_24 = Panel(material_property.unit)
panel_25 = Panel(material_property.value)
panel_26 = Panel(material_property.debug)
